# Dynamo graph Air Terminal Calculations.dyn "AirTerminals" (Dynamo 2.0.3.8810)

air_terminal_flow_totals = Custom[Air Terminal Flow Totals]()  # Calculates the total airflows from all Air Terminals in a Revit project. Index 0 = Supply airflow total Index 1 = Return airflow total Index 2 = Exhaust airflow total
watch = Watch(air_terminal_flow_totals)
toString = Custom[Springs.Number.ToString](num=watch)  # Converts the input number(s) to string. You can optionally limit the number of digits.
code_block = CodeBlock { 0; }
getItemAtIndex = List.GetItemAtIndex(list=toString, index=code_block)
string = StringInput(", ")
code_block_2 = CodeBlock { 1; }
getItemAtIndex_2 = List.GetItemAtIndex(list=toString, index=code_block_2)
code_block_3 = CodeBlock { 2; }
getItemAtIndex_3 = List.GetItemAtIndex(list=toString, index=code_block_3)
concat = String.Concat(string0=getItemAtIndex, string1=string, string2=getItemAtIndex_2, string3=string, string4=getItemAtIndex_3)
dialog = Custom[Dialog](message=concat)  # Displays an alert box in Revit
