# Dynamo custom node Air Terminal Flow Totals.dyf (Dynamo 2.0.3.8810)
# category: Custom
# Calculates the total airflows from all Air Terminals in a Revit project.
# Index 0 = Supply airflow total
# Index 1 = Return airflow total
# Index 2 = Exhaust airflow total

categories = Categories(index=5)
all_elements_of_category = ElementsOfCategory(Category=categories)
python_script = Python(IN[0]=all_elements_of_category)  # unwired: IN[1], IN[2]
# ---------- python_script.python (27 lines) ----------
import clr
clr.AddReference('RevitNodes')
import Revit
clr.ImportExtensions(Revit.Elements)

elements = IN[0]

totalSupply = 0
totalReturn = 0
totalExhaust = 0

for e in elements:
	system = e.GetParameterValueByName("System Classification")
	airflow = e.GetParameterValueByName("Flow")
	
	if system == "Supply Air":
		totalSupply += airflow
	
	if system == "Return Air":
		totalReturn += airflow
	
	if system == "Exhaust Air":
		totalExhaust += airflow

totals = [totalSupply, totalReturn, totalExhaust]

OUT = totals
# ----------------------------------------
