# Dynamo graph Air Terminal Flow Totals-v2.2.1.5291.dyn (Dynamo 2.2.1.5175)

categories = Categories("OST_DuctTerminal")
all_elements_of_category = ElementsOfCategory(Category=categories)
code_block = CodeBlock { "Supply Air"; }
code_block_2 = CodeBlock { "Return Air"; }
code_block_3 = CodeBlock { "Exhaust Air"; }
list_create = List.Create(item0=code_block, item1=code_block_2, item2=code_block_3)
python_script = Python(IN[0]=all_elements_of_category, IN[1]=list_create)  # unwired: IN[2]
# ---------- python_script.python (19 lines) ----------
import clr
clr.AddReference('RevitNodes')

elements = IN[0]
systems = IN[1]
totals = []
	
for i in range(len(systems)):
	
	total = 0
	for e in elements:
		system = e.GetParameterValueByName("System Classification")
		airflow = e.GetParameterValueByName("Flow")
	
		if system == systems[i]: total += airflow
	
	totals.append(total)

OUT = totals
# ----------------------------------------
