# Dynamo graph create_sheet_set.dyn "Create Sheet Set-v2.2.1.5291" (Dynamo 2.2.1.5175)

categories = Categories("OST_Sheets")  # graph input
all_elements_of_category = ElementsOfCategory(Category=categories)
revisions = archilab.Revit.Views.Sheets.Revisions(sheet=all_elements_of_category)
revision_properties = Custom[Revision Properties](revision=revisions)  # This node will return some most common Revision properties like Description or Issue Date.
flatten = List.Flatten(list=revision_properties.description)
string = StringInput("Revision 1")  # graph input
eq = flatten == string
filterByBoolMask = List.FilterByBoolMask(list=all_elements_of_category, mask=eq)
boolean = BoolSelector(true)  # graph input
byViewsName = archilab.Revit.Views.ViewSets.ByViewsName(views=filterByBoolMask.in, name=string, replace=boolean)
