# Dynamo graph export_revit_link_data.dyn (Dynamo 3.6.1.9895)

file_path = Filename(".\revit_link_data.csv")
python_script = Python(IN[0]=file_path)  # CPython3
# ---------- python_script.python (114 lines) ----------
import clr
import csv
import math
import os
import sys
from pathlib import Path
from datetime import datetime

clr.AddReference("RevitServices")
from RevitServices.Persistence import DocumentManager

clr.AddReference("RevitAPI")
from Autodesk.Revit.DB import *

def delete_if_not_modified_today(file_path):
    p = Path(file_path)
    if not p.exists():
        print(f"File not found: {p}")
        return
    if not p.is_file():
        print(f"Not a file: {p}")
        return

    mod_date = datetime.fromtimestamp(p.stat().st_mtime).date()
    today = datetime.now().date()

    if mod_date != today:
        try:
            p.unlink()
            print(f"Deleted: {p} (modified: {mod_date})")
        except Exception as e:
            print(f"Error deleting {p}: {e}")
    else:
        print(f"Kept: {p} (modified: {mod_date})")

def get_link_base_point(link_instance, link_transform):
    link_doc = link_instance.GetLinkDocument()
    if link_doc is not None:
        collector = FilteredElementCollector(link_doc).OfClass(BasePoint)
        for base_point in collector:
            if not base_point.IsShared:
                link_base_point_in_link = base_point.Position
                link_base_point_in_host = link_transform.OfPoint(link_base_point_in_link)
                return link_base_point_in_host
    return None

def get_host_base_point(doc):
    collector = FilteredElementCollector(doc).OfClass(BasePoint)
    
    for base_point in collector:
        if not base_point.IsShared:
            return base_point.Position
    
    return None

file_path = IN[0]

delete_if_not_modified_today(file_path)

doc = DocumentManager.Instance.CurrentDBDocument

collector = FilteredElementCollector(doc).OfClass(RevitLinkInstance)
link_instances = list(collector)
non_nested_link_instances = []

for link in link_instances:
    type_id = link.GetTypeId()
    element = doc.GetElement(type_id)

    if isinstance(element, RevitLinkType):
        revit_link_type = element

    if not revit_link_type.IsNestedLink:
        non_nested_link_instances.append(link)

project_location = doc.ActiveProjectLocation
project_position = project_location.GetProjectPosition(XYZ(0,0,0))

header = ["Document Title", "Link Name", "Workset Name", "Pinned", "Host XYZ", "Link XYZ", "Date"]
data_rows = []

for link_inst in non_nested_link_instances:
    try:
        link_name = link_inst.Name
    except:
        link_name = "Unknown"
    
    pinned = link_inst.Pinned

    ws_id = link_inst.WorksetId
    ws = doc.GetWorksetTable().GetWorkset(ws_id)
    ws_name = ws.Name if ws else "None"
    
    transform = link_inst.GetTransform()
    host_base_point = get_host_base_point(doc)
    link_base_point = get_link_base_point(link_inst, transform)

    date = datetime.now().strftime('%Y-%m-%d %H:%M:%S')

    data_rows.append([doc.Title, link_name, ws_name, pinned, host_base_point, link_base_point, date])

try:
    file_exists = os.path.isfile(file_path)
    with open(file_path, "a", newline='', encoding='utf-8') as csvfile:
        writer = csv.writer(csvfile)
        if not file_exists:
            writer.writerow(header)
        for row in data_rows:
            writer.writerow(row)
    result = "CSV appended to: " + file_path
except Exception as e:
    result = "Error: " + str(e)

OUT = result
# ----------------------------------------
