# Dynamo graph load_families_insert_parameters.dyn (Dynamo 2.19.3.6394)

# group: Families to load
# Provide full UNC paths. Must be a server path that Clarity has access to.
unc_path_of_family_to_load = StringInput("\\arcadis-nl.local\dfs\ADPS_PJ\Philadelphia\PPR_Proj\2024\D24PA044\05 Design\14 Drawings\01 WIP\13 BIM Mgr\Clarity\Scripts\Test\D24PA044-ELY-Title-BH.rfa")
unc_path_of_family_to_load_2 = StringInput("\\arcadis-nl.local\dfs\ADPS_PJ\Philadelphia\PPR_Proj\2024\D24PA044\05 Design\14 Drawings\01 WIP\13 BIM Mgr\Clarity\Scripts\Test\D24PA044-ELY-Title-E1-Sketch.rfa")
list_create = List.Create(item0=unc_path_of_family_to_load, item1=unc_path_of_family_to_load_2)

# group: Shared parameter file
# Provide full UNC paths. Must be a server path that Clarity has access to.
unc_path_of_shared_parameter = StringInput("\\arcadis-nl.local\dfs\ADPS_PJ\Philadelphia\PPR_Proj\2024\D24PA044\05 Design\14 Drawings\01 WIP\13 BIM Mgr\Clarity\Scripts\Test\D24PA044-ARC-Shared Parameters-Sheets.txt")  # "UNC path of shared parameter file"

# group: GUID's of the shared parameters
# Open the shared parameter file in excel and copy/paste to here. Add parameters as needed, but they must be from the specified shared parameter file above. Add more as needed.
string = StringInput("7d7edc48-1da7-4e26-b672-fe06e3f352b1")
string_2 = StringInput("3867209d-74ef-4c7a-9386-875e6ae31ee9")
list_of_shared_parameter_guids = List.Create(item0=string, item1=string_2)  # "List of shared parameter guids to load"

# group: Categories to bind parameters to
# Add more as needed
categories = Categories("OST_Sheets")
list_of_categories_to_bind_to = List.Create(item0=categories)

python_script = Python(IN[0]=list_create, IN[1]=unc_path_of_shared_parameter, IN[2]=list_of_shared_parameter_guids, IN[3]=list_of_categories_to_bind_to)  # CPython3
# ---------- python_script.python (88 lines) ----------
# Load the Python Standard and DesignScript Libraries
import sys
import clr
clr.AddReference('ProtoGeometry')
from Autodesk.DesignScript.Geometry import *

clr.AddReference("RevitServices")
from RevitServices.Persistence import DocumentManager

clr.AddReference("RevitAPI")
from Autodesk.Revit.DB import *
from Autodesk.Revit.ApplicationServices import *

unc_paths_families = IN[0]
unc_path_spfile = IN[1]
guids = IN[2]
categories = IN[3]

def get_shared_parameter_by_guid(app, guid):
    # Loop through shared parameter file, return Definition that matches GUID
    sp_file = app.OpenSharedParameterFile()
    if sp_file is None:
        return None
    for group in sp_file.Groups:
        for definition in group.Definitions:
            ext_def = definition
            if hasattr(ext_def, "GUID") and str(ext_def.GUID).upper() == guid.upper():
                return ext_def
    return None

def bind_shared_parameter(doc, definition, categories):
    
    for cat in categories:
        cat = doc.Settings.Categories.get_Item(cat.Name)
        cats = app.Create.NewCategorySet()
        cats.Insert(cat)
        ib = app.Create.NewInstanceBinding(cats)
    
    binding_map = doc.ParameterBindings

    if not binding_map.Contains(definition):
        if revit_version < 2025:
            group = BuiltInParameterGroup.PG_DATA
            result = binding_map.Insert(definition, ib, group)
        else:  # Revit 2025+
            group = ForgeTypeId(GroupTypeId.Data)
            result = binding_map.Insert(definition, ib, group)
        return "Inserted: " + definition.Name if result else "Failed to insert: " + definition.Name
    else:
        return "Already exists: " + definition.Name

doc = DocumentManager.Instance.CurrentDBDocument
app = doc.Application
revit_version = int(app.VersionNumber)  # e.g., 2020, 2021, 2022, etc.

trans = Transaction(doc, "Load family and parameters")

trans.Start()

# Load titleblock family from file
for unc_path_family in unc_paths_families:
    doc.LoadFamily(unc_path_family)

# Set shared parameter file
app.SharedParametersFilename = unc_path_spfile

results = []
for guid in guids:
    definition = get_shared_parameter_by_guid(app, guid)
    if definition:
        result = bind_shared_parameter(doc, definition, categories)
        results.append(result)
    else:
        results.append("Not found in Shared Parameters: " + guid)
OUT = results

trans.Commit()

transOptions = TransactWithCentralOptions()
syncOptions = SynchronizeWithCentralOptions()
relinquishOptions = RelinquishOptions(None)

syncOptions.SetRelinquishOptions(relinquishOptions)

syncOptions.SaveLocalBefore = True
syncOptions.SaveLocalAfter = True

doc.SynchronizeWithCentral(transOptions, syncOptions)
# ----------------------------------------
